# Grasshopper definition LeafExample1.gh (Grasshopper 1.0.7)
# plug-ins: Leaf

leaf_instructions = LeafInstructions()
panel = Panel(leaf_instructions)

# ----
# Warning:
# You may experience a crash if the cycle is too high. Make frequent saves.
# If you're using context sensitive rules and simple substitutin rules, the context sensitive rules must come before the simple
panel_2 = Panel("""a^<a=LLLL
a=ak
k(0.1)=+bbh
b=b^a""")
panel_3 = Panel("""a=ab
b(0.5)=a[+a]=[-a]""")

cycle = Slider(10, range=0..15)
brep = Brep(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)
point = Point([Point(-81.80169788, -77.05364618, 0), Point(-81.80169788, -77.05364618, 3.8), Point(-81.80169788, -80.85364618, 0)])
brep_2 = Brep(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)
point_2 = Point([Point(-81.80169788, -77.05364618, 0), Point(-81.80169788, -77.05364618, 3.8), Point(-81.80169788, -80.85364618, 0)])
leaf_geometry = LeafGeometry(Symbol="b", Geometry=brep, Points=point)
leaf_geometry_2 = LeafGeometry(Symbol="a", Geometry=brep_2, Points=point_2)
angle = Slider(90, range=0..360)
leaf_system = LeafSystem(Rules=panel_3, Axiom="a", Cycle=cycle)
panel_4 = Panel(leaf_system)
leaf_turtle = LeafTurtle(ShapeCode=leaf_system, VoxelSize=1, Angle=angle, StepDistance=1, LeafGeometry=[leaf_geometry_2, leaf_geometry])
